# Dynamo graph Random panel colour script.dyn "Panel random colour pattern script tested on curtain walls without watch node to check lists" (Dynamo 3.3.0.6316)

select_model_element = DSModelElementSelection()  # 1 picked in the model
byElement = CurtainPanel.ByElement(hostingElement=select_model_element)
code_block = CodeBlock { "Type"; }
family_types = FamilyTypes("Familie panouri cu parasolare draft:Amber curtain panel family sunshade colour")
family_types_2 = FamilyTypes("Familie panouri cu parasolare draft:Bright orange curtain panel family sunshade colour")
family_types_3 = FamilyTypes("Familie panouri cu parasolare draft:Fiery red curtain panel family sunshade colour")
family_types_4 = FamilyTypes("Familie panouri cu parasolare draft:Familie panouri cu parasolare draft")
family_types_5 = FamilyTypes("Familie panouri cu parasolare draft:Peach glow curtain panel family sunshade colour")
list_create = List.Create(item0=family_types, item1=family_types_2, item2=family_types_3, item3=family_types_4, item4=family_types_5)
count = List.Count(list=byElement)
count_2 = List.Count(list=list_create)
div = count / count_2
cycle = List.Cycle(list=list_create, amount=div)
integer_slider = IntegerSlider(39, range=0..100 step 1)
shuffle = List.Shuffle(list=cycle, seed=integer_slider)
setParameterByName = Element.SetParameterByName(element=byElement, parameterName=code_block, value=shuffle)
